# Dynamo graph AutoScheduleCreate.dyn (Dynamo 2.6.1.8786)

categories = Categories("OST_FlexPipeCurves")
string = StringInput("Flex Pipe Schedule2")
schedule_type = ScheduleTypes("RegularSchedule")
createSchedule = ScheduleView.CreateSchedule(category=categories, name=string, scheduleType=schedule_type)
schedulableFields = ScheduleView.SchedulableFields(scheduleView=createSchedule)
code_block = CodeBlock(x=schedulableFields) { x[33]; x[3]; x[7]; x[40]; x[68]; x[36]; }
code_block_2 = CodeBlock(p=code_block.out0, q=code_block.out1, r=code_block.out2, s=code_block.out3, t=code_block.out4, u=code_block.out5) { [p,q,r,s,t,u]; }
addFields = ScheduleView.AddFields(scheduleView=createSchedule, fields=code_block_2)
categories_2 = Categories("OST_PipeCurves")
string_2 = StringInput(" Pipe Schedule2")
schedule_type_2 = ScheduleTypes("RegularSchedule")
createSchedule_2 = ScheduleView.CreateSchedule(category=categories_2, name=string_2, scheduleType=schedule_type_2)
schedulableFields_2 = ScheduleView.SchedulableFields(scheduleView=createSchedule_2)
code_block_3 = CodeBlock(x=schedulableFields_2) { x[43]; x[3]; x[11]; x[50]; x[79]; x[46]; }
code_block_4 = CodeBlock(p=code_block_3.out0, q=code_block_3.out1, r=code_block_3.out2, s=code_block_3.out3, t=code_block_3.out4, u=code_block_3.out5) { [p,q,r,s,t,u]; }
addFields_2 = ScheduleView.AddFields(scheduleView=createSchedule_2, fields=code_block_4)
